# Grasshopper definition Egg.gh (Grasshopper 1.0.7)
# plug-ins: Pufferfish

pt = Point(Point(0, 0, 0))
Z = UnitZ(Factor=Slider(10, range=0..10))
Z_2 = UnitZ(Factor=Slider(52, range=0..100))
move = Move(Geometry=pt, Motion=Z)  # -> Geometry, Transform
move_2 = Move(Geometry=pt, Motion=Z_2)  # -> Geometry, Transform
cir = Circle(Plane=pt, Radius=Slider(15, range=0..100))
cir_2 = Circle(Plane=move.Geometry, Radius=Slider(10, range=0..100))
cir_3 = Circle(Plane=move_2.Geometry, Radius=Slider(30, range=0..100))
number_slider = Slider(16, range=0..100)
divide = DivideCurve(Curve=cir, Count=number_slider, Kinks=False)  # -> Points, Tangents, Parameters
divide_2 = DivideCurve(Curve=cir_2, Count=number_slider, Kinks=False)  # -> Points, Tangents, Parameters
divide_3 = DivideCurve(Curve=cir_3, Count=number_slider, Kinks=False)  # -> Points, Tangents, Parameters
number_slider_2 = Slider(1, range=-10..10)
number_slider_3 = Slider(4, range=-10..10)
neg = Negative(Value=number_slider_2)
neg_2 = Negative(Value=number_slider_3)
shift = ShiftList(List=divide.Points, Shift=Slider(0, range=-10..10), Wrap=True)  # -> graft(List)
shift_2 = ShiftList(List=divide_2.Points, Shift=number_slider_2, Wrap=True)  # -> graft(List)
shift_3 = ShiftList(List=divide_3.Points, Shift=number_slider_3, Wrap=True)  # -> graft(List)
shift_4 = ShiftList(List=divide.Points, Shift=Slider(0, range=-10..10), Wrap=True)  # -> graft(List)
shift_5 = ShiftList(List=divide_2.Points, Shift=neg, Wrap=True)  # -> graft(List)
shift_6 = ShiftList(List=divide_3.Points, Shift=neg_2, Wrap=True)  # -> graft(List)
intcrv = Interpolate(Vertices=[shift, shift_2, shift_3], Degree=3, Periodic=False, KnotStyle=1)  # -> Curve, Length, Domain
intcrv_2 = Interpolate(Vertices=[shift_4, shift_5, shift_6], Degree=3, Periodic=False, KnotStyle=1)  # -> Curve, Length, Domain
dispatch = Dispatch(List=flatten(intcrv_2.Curve), DispatchPattern=[True, False])  # -> ListA, ListB
divide_4 = DivideCurve(Curve=intcrv.Curve, Count=10, Kinks=False)  # -> Points, Tangents, Parameters
divide_5 = DivideCurve(Curve=intcrv_2.Curve, Count=10, Kinks=False)  # -> Points, Tangents, Parameters
dispatch_2 = Dispatch(List=divide_4.Points, DispatchPattern=[True, False])  # -> ListA, ListB
dispatch_3 = Dispatch(List=divide_5.Points, DispatchPattern=[True, False])  # -> ListA, ListB
item = ListItem(List=reverse(dispatch_2.ListA), Index=Slider(0, range=0..10), Wrap=True)
item_2 = ListItem(List=reverse(dispatch_2.ListB), Index=Slider(0, range=0..10), Wrap=True)
item_3 = ListItem(List=reverse(dispatch_3.ListB), Index=Slider(0, range=0..10), Wrap=True)
item_4 = ListItem(List=dispatch_2.ListA, Index=Slider(0, range=0..10), Wrap=True)
item_5 = ListItem(List=dispatch_2.ListB, Index=Slider(0, range=0..10), Wrap=True)
item_6 = ListItem(List=dispatch_3.ListB, Index=Slider(0, range=0..10), Wrap=True)
dispatch_4 = Dispatch(List=flatten(item), DispatchPattern=[True, False])  # -> ListA, ListB
dispatch_5 = Dispatch(List=flatten(item_2), DispatchPattern=[True, False])  # -> ListA, ListB
dispatch_6 = Dispatch(List=flatten(item_3), DispatchPattern=[True, False])  # -> ListA, ListB
dispatch_7 = Dispatch(List=flatten(item_4), DispatchPattern=[True, False])  # -> ListA, ListB
dispatch_8 = Dispatch(List=flatten(item_5), DispatchPattern=[True, False])  # -> ListA, ListB
dispatch_9 = Dispatch(List=flatten(item_6), DispatchPattern=[True, False])  # -> ListA, ListB
merge = Merge(Data1=dispatch_4.ListA, Data2=dispatch_5.ListB, Data3=dispatch_6.ListB)  # -> flatten(Result)
merge_2 = Merge(Data1=dispatch_7.ListA, Data2=dispatch_8.ListB, Data3=dispatch_9.ListB)  # -> flatten(Result)
dispatch_10 = Dispatch(List=flatten(intcrv.Curve), DispatchPattern=[True, False])  # -> ListA, ListB
alongcrv = SortAlongCurve(Points=merge, Curve=cir_3)  # -> Points, Indices
alongcrv_2 = SortAlongCurve(Points=merge_2, Curve=cir_3)  # -> Points, Indices
geo = Geometry(flatten([dispatch_10.ListA, dispatch.ListA]))
intcrv_3 = Interpolate(Vertices=alongcrv.Points, Degree=3, Periodic=True, KnotStyle=1)  # -> Curve, Length, Domain
intcrv_4 = Interpolate(Vertices=alongcrv_2.Points, Degree=3, Periodic=True, KnotStyle=1)  # -> Curve, Length, Domain
loft = Loft(
    Curves=flatten(intcrv.Curve),
    Options={Adjust=False, Closed=True, LoftEnds=0, LoftSimp=0, LoftType=0, Rebuild=10, Refit=0.01})
pipe = Pipe(Curve=geo, Radius=Slider(0.8, range=0..2), Caps=2)
srfsplit = SurfaceSplit(Surface=loft, Curves=flatten([intcrv_3.Curve, intcrv_4.Curve]))
geo_2 = Geometry(flatten([dispatch_10.ListB, dispatch.ListB]))
bbox = BoundingBox(Content=srfsplit, Plane=PlaneXY(0, 0, 0))  # -> Box, Box_2
ccx = CurveCurve(CurveA=geo_2, CurveB=intcrv_3.Curve)  # -> Points, ParamsA, ParamsB
volume = Volume(Geometry=bbox.Box)  # -> Volume, Centroid
trimcrvpts = TrimCurveWithPoints(Curve=graft(geo_2), Points=ccx.Points)  # -> flatten(Trimmed)
sort = SortList(Keys=volume.Volume, ValuesA=srfsplit)  # -> Keys, ValuesA
item_7 = ListItem(List=reverse(sort.ValuesA), Index=0, Wrap=True)
ccx_2 = CurveCurve(CurveA=graft(geo), CurveB=trimcrvpts)  # -> flatten(Points), ParamsA, ParamsB
crv_cp = CurveClosestPoint(Point=ccx_2.Points, Curve=graft(trimcrvpts))  # -> Point, Parameter, Distance
offsrf = OffsetSurface(Surface=item_7, Distance=expr("-x", Slider(2, range=0..10)), BothSides=False, CreateSolid=True)
sort_2 = SortList(Keys=crv_cp.Distance, ValuesA=ccx_2.Points)  # -> Keys, ValuesA
item_8 = ListItem(List=sort_2.ValuesA, Index=0, Wrap=True)
flip = FlipCurve(Curve=trimcrvpts)  # -> Curve, Flag
trimcrvpts_2 = TrimCurveWithPoints(Curve=graft(flip.Curve), Points=item_8)  # -> flatten(Trimmed)
pipe_2 = Pipe(Curve=trimcrvpts_2, Radius=Slider(0.4, range=0..2), Caps=2)
merge_3 = Merge(Data1=pipe, Data2=pipe_2, Data3=offsrf)  # -> flatten(Result)
srf = Surface(cir)
scale = Scale(Geometry=srf, Center=Point(0, 0, 0), Factor=2)  # -> Geometry, Transform
Z_3 = UnitZ(Factor=Slider(2, range=0..10))
rev = Reverse(Vector=Z_3)
move_3 = Move(Geometry=merge_3, Motion=rev)  # -> Geometry, Transform
split = SplitBrep(Brep=move_3.Geometry, Cutter=scale.Geometry)
item_9 = ListItem(List=split, Index=0, Wrap=True)
cap = CapHoles(Brep=item_9)  # -> flatten(Brep)
preview = CustomPreview(Geometry=cap, Material=ColourSwatch(SwatchColor=RGB(162, 168, 52)))
